# Grasshopper definition vase1.gh (Grasshopper 1.0.7)
# plug-ins: Human

panel = Panel("30 steps for 30 circles")
number_slider = Slider(30, range=0..100)
range = Range(Domain=Domain(0, 1), Steps=number_slider)
graph = GraphMapper(
    range,
    x0=0,
    x1=1,
    y0=0,
    y1=1,
    container_name="Bezier",
    cpx=[0, 0.4046904743, 0.09629752487, 1],
    cpy=[0.0980924964, 0.5455648303, 0.0980924964, 0.05194437504])
height = Slider(100, range=0..100)
# 30 circles placed on the XY Plane
xy = XYPlane(Origin=Point(0, 0, 0))
multiplication = Multiplication(A=Slider(73, range=0..100), B=graph)
# The graph defines the shape of the vase
range_2 = Range(Domain=height, Steps=number_slider)
Z = UnitZ(Factor=range_2)
cir = Circle(Plane=xy, Radius=multiplication)
# Move the circles on the z axis
move = Move(Geometry=cir, Motion=Z)  # -> Geometry, Transform
# Mapping 100 points on each circle
number_slider_2 = Slider(100, range=0..100)
divide = DivideCurve(Curve=move.Geometry, Count=number_slider_2, Kinks=False)  # -> Points, Tangents, Parameters
avr = Average(Input=divide.Points)
tstat = TreeStatistics(Tree=divide.Points)  # -> Paths, Length, Count
vec2pt = Vector2Pt(PointA=divide.Points, PointB=avr, Unitize=False)  # -> Vector, Length
range_3 = Range(Domain=Domain(0, 1), Steps=expr("x-1", 10))
number_slider_3 = Slider(0.361, range=0..1)
dispatch = Dispatch(List=divide.Points, DispatchPattern=[True, False])  # -> ListA, ListB
dispatch_2 = Dispatch(List=vec2pt.Vector, DispatchPattern=[True, False])  # -> ListA, ListB
graph_2 = GraphMapper(range_3)
multiplication_2 = Multiplication(B=graph_2)
amp = Amplitude(Vector=dispatch_2.ListA, Amplitude=number_slider_3)
amp_2 = Amplitude(Vector=dispatch_2.ListB, Amplitude=number_slider_3)
rev = Reverse(Vector=amp_2)
# Move 100 points on each circle in one way
move_2 = Move(Geometry=dispatch.ListA, Motion=amp)  # -> Geometry, Transform
# Move 100 points on each circle in the way different from the above
move_3 = Move(Geometry=dispatch.ListB, Motion=rev)  # -> Geometry, Transform
# Move 100 points on each circle in the way different from the above
weave = Weave(Pattern=[0, 1], Stream0=move_2.Geometry, Stream1=move_3.Geometry, NullGaps=False)
pi = Pi(Factor=Slider(1, range=0..1))
# join the points on every plane to form the wavy circles
intcrv = Interpolate(Vertices=weave, Degree=3, Periodic=invert(False), KnotStyle=1)  # -> flatten(Curve), Length, Domain
range_4 = Range(Domain=pi, Steps=expr("x-1", tstat.Count))
# Rotate function to give the swirl to the vase
rotate = Rotate(Geometry=intcrv.Curve, Angle=range_4, Plane=PlaneXY(0, 0, 0))  # -> Geometry, Transform
# Vase structure with the rotational texture
loft = Loft(Curves=rotate.Geometry, Options={Adjust=False, Closed=False, LoftEnds=0, LoftSimp=0, LoftType=0, Rebuild=10, Refit=0.01})
# Vase structure with the rotational texture
loft_2 = Loft(Curves=move.Geometry, Options={Adjust=False, Closed=False, LoftEnds=0, LoftSimp=0, LoftType=0, Rebuild=10, Refit=0.01})
number_slider_4 = Slider(0.869, range=0..1)
box = EvaluateBox(Box=loft_2, UParameter=0.5, VParameter=0.5, WParameter=Slider(1, range=0..1))  # -> Plane, Point, Include
scale_nu = ScaleNU(Geometry=loft_2, Plane=box.Plane, ScaleX=number_slider_4, ScaleY=number_slider_4, ScaleZ=Slider(0.987, range=0..1))  # -> Geometry, Transform
Z_2 = UnitZ(Factor=Slider(0.9, range=0..1))
# Move the vase structure without waves a little inside to generate the space to form inner wall of the final vase
move_4 = Move(Geometry=scale_nu.Geometry, Motion=Z_2)  # -> Geometry, Transform
cap = CapHoles(Brep=loft)
# Cap holes for both the stuctures and subtract the smaller & vase without waves from the bigger vase with swirly waves
cap_2 = CapHoles(Brep=move_4.Geometry)
sdiff = SolidDifference(BrepsA=cap, BrepsB=cap_2)
previewmat = CustomPreviewMaterials(Geometry=sdiff, DiffuseColor=RGB(254, 255, 255))
